# Grasshopper definition test.gh (Grasshopper 1.0.7)
# plug-ins: WFC Solver

panel = Panel("""0
0
1
1
0
0
1
1""")
panel_2 = Panel("""0
1
0
1
0
1
0
1""")
panel_3 = Panel("""0
0
0
0
1
1
1
1""")
number_slider = Slider(2, range=0..10)
vector_xyz = VectorXYZ(XComponent=panel_2, YComponent=panel, ZComponent=panel_3)  # -> Vector, Length
panel_4 = Panel("""0
0
0
1
1
1""")
panel_5 = Panel("""1
1
1
0
0
0""")
panel_6 = Panel("""x
y
z
x
y
z""")
vector_xyz_2 = VectorXYZ(XComponent=number_slider, YComponent=number_slider, ZComponent=number_slider)  # -> Vector, Length
repeat_data = RepeatData(Data=vector_xyz.Vector, Length=Slider(16, range=0..16))
panel_7 = Panel(repeat_data)
panel_8 = Panel("""0
0
0
0
0
0
0
0
1
1
1
1
1
1
1
1""")
longest_list = LongestList(ListA=panel_7, ListB=panel_8, PaddingMode=2)  # -> ListA, ListB
wave_function_collapse_3d = WaveFunctionCollapse3D(
    RuleAxis=panel_6,
    RuleLow=panel_4,
    RuleHigh=panel_5,
    WorldSize=vector_xyz_2.Vector,
    SlotPositions=longest_list.ListA,
    SlotModules=longest_list.ListB,
    RandomSeed=Slider(36, range=0..100),
    MaxAttempts=100)  # -> Out, SlotPositions, SlotModules
panel_9 = Panel(wave_function_collapse_3d.Out)
panel_10 = Panel(wave_function_collapse_3d.SlotPositions)
panel_11 = Panel(wave_function_collapse_3d.SlotModules)
